# Grasshopper definition RotationBox.gh (Grasshopper 1.0.7)
# plug-ins: Bifocals

nxn = Slider(8, range=0..10)
size = Slider(22.55, range=0..90)
size_2 = Slider(4.24, range=0..90)
python = GhPythonScript(x=size)  # -> Radius, Diameter
# ---------- python: Python ----------
Diameter = x
Radius = x / 2
# ---------- end python ----------
rad = Radians(Degrees=Slider(90, range=0..90))
python_2 = GhPythonScript(RowNum=nxn, ColNum=nxn, Theta=rad)  # -> out, RotAngle; inputs RowNum: Int32, ColNum: Int32
# ---------- python_2: Python ----------
import math

RotAngle = []
cur = -1;
for i in range(0, RowNum):
    cur = cur * -1;
    for k in range(0, ColNum):
        f = cur * (-1 if k % 2 == 0 else 1) * Theta
        RotAngle.append(f)
# ---------- end python_2 ----------
python_3 = GhPythonScript(RowNum=nxn, ColNum=nxn, Diameter=python.Diameter, Theta=rad)  # -> out, Points; inputs RowNum: Int32, ColNum: Int32
# ---------- python_3: Python ----------
import math
import Rhino

d = math.sqrt(2) * Diameter * math.cos(Theta - 45 / 180 * math.pi)

PointPos = []
Points = []
for i in range(0, RowNum):
    PointPos.append([])
    for k in range(0, ColNum):
        x = (i - RowNum // 2) * d
        y = (k - ColNum // 2) * d
        print((x, y))
        PointPos[i].append((x, y))
        Points.append(Rhino.Geometry.Point3d(x, y, 0))
# ---------- end python_3 ----------
Z = UnitZ(Factor=1)
addition = Addition(A=python_3.Points, B=Z)
python_4 = GhPythonScript(
    RowNum=nxn,
    ColNum=nxn,
    CubeCenterPts=python_3.Points,
    CubeRotAngle=python_2.RotAngle,
    CubeRadius=python.Radius,
    Theta=rad)  # -> out, SpherePosPts, SphereRotAxis, SphereRotAngle; inputs RowNum: Int32, ColNum: Int32, CubeCenterPts: list of Point3d, CubeRotAngle: list
# ---------- python_4: Python ----------
__author__ = "Petingo"
__version__ = "2023.10.30"

import math
import Rhino
import rhinoscriptsyntax as rs

SpherePosPts = []
SphereRotAxis = []
SphereRotAngle = []
for i in range(0, RowNum, 2):
    for k in range(0, ColNum, 2):
        ptIdx = i * RowNum + k
        cubeCenterPt = CubeCenterPts[ptIdx]
        
        xShift = math.cos(2 * Theta) * CubeRadius
        
        pt = Rhino.Geometry.Point3d(
            cubeCenterPt.X - xShift,
            cubeCenterPt.Y,
            cubeCenterPt.Z
        )
    
        SpherePosPts.append(pt)
# ---------- end python_4 ----------
python_5 = GhPythonScript(
    RowNum=nxn,
    ColNum=nxn,
    CubeCenterPts=python_3.Points,
    CubeRotAngle=python_2.RotAngle,
    CubeRadius=python.Radius,
    Theta=rad)  # -> out, SpherePosPts, SphereRotAxis, SphereRotAngle; inputs RowNum: Int32, ColNum: Int32, CubeCenterPts: list of Point3d, CubeRotAngle: list
# ---------- python_5: Python ----------
__author__ = "Petingo"
__version__ = "2023.10.30"

import math
import Rhino
import rhinoscriptsyntax as rs

SpherePosPts = []
SphereRotAxis = []
SphereRotAngle = []
for i in range(1, RowNum, 2):
    for k in range(1, ColNum, 2):
        ptIdx = i * RowNum + k
        cubeCenterPt = CubeCenterPts[ptIdx]
        
        xShift = -math.cos(2 * Theta) * CubeRadius
        
        pt = Rhino.Geometry.Point3d(
            cubeCenterPt.X - xShift,
            cubeCenterPt.Y,
            cubeCenterPt.Z
        )
    
        SpherePosPts.append(pt)
# ---------- end python_5 ----------
addition_2 = Addition(A=python.Radius, B=size_2)
ln = Line(StartPoint=addition, EndPoint=python_3.Points)
addition_3 = Addition(A=python.Radius, B=size_2)
box = CenterBox(Base=python_3.Points, X=python.Radius, Y=python.Radius, Z=python.Radius)
Z_2 = UnitZ(Factor=addition_2)
Z_3 = UnitZ(Factor=addition_3)
rotax = RotateAxis(Geometry=box, Angle=python_2.RotAngle, Axis=ln)  # -> Geometry, Transform
move = Move(Geometry=python_5.SpherePosPts, Motion=Z_3)  # -> Geometry, Transform
move_2 = Move(Geometry=python_4.SpherePosPts, Motion=Z_2)  # -> Geometry, Transform
sph = Sphere(Base=move.Geometry, Radius=size_2)
sph_2 = Sphere(Base=move_2.Geometry, Radius=size_2)
preview = CustomPreview(Geometry=rotax.Geometry, Material=ColourSwatch(SwatchColor=RGB(255, 255, 255)))
preview_2 = CustomPreview(Geometry=sph, Material=ColourSwatch(SwatchColor=RGB(112, 177, 212)))  # disabled
preview_3 = CustomPreview(Geometry=sph_2, Material=ColourSwatch(SwatchColor=RGB(212, 112, 139)))  # disabled

data = Data(nxn)
data_2 = Data(size_2)
data_3 = Data(size)

python_6 = GhPythonScript(x=data_3)  # -> Radius, Diameter; same code as python
rad_2 = Radians(Degrees=Slider(90, range=0..90))
python_7 = GhPythonScript(RowNum=data, ColNum=data, Theta=rad_2)  # -> out, RotAngle; inputs RowNum: Int32, ColNum: Int32; same code as python_2
python_8 = GhPythonScript(RowNum=data, ColNum=data, Diameter=python_6.Diameter, Theta=rad_2)  # -> out, Points; inputs RowNum: Int32, ColNum: Int32; same code as python_3
Z_4 = UnitZ(Factor=1)
addition_4 = Addition(A=python_8.Points, B=Z_4)
python_9 = GhPythonScript(
    RowNum=data,
    ColNum=data,
    CubeCenterPts=python_8.Points,
    CubeRotAngle=python_7.RotAngle,
    CubeRadius=python_6.Radius,
    Theta=rad_2)  # -> out, SpherePosPts, SphereRotAxis, SphereRotAngle; inputs RowNum: Int32, ColNum: Int32, CubeCenterPts: list of Point3d, CubeRotAngle: list
# ---------- python_9: Python ----------
__author__ = "Petingo"
__version__ = "2023.10.30"

import math
import Rhino
import rhinoscriptsyntax as rs

SpherePosPts = []
SphereRotAxis = []
SphereRotAngle = []
for i in range(1, RowNum, 2):
    for k in range(0, ColNum, 2):
        ptIdx = i * RowNum + k
        cubeCenterPt = CubeCenterPts[ptIdx]
        
        xShift = math.cos(2 * Theta) * CubeRadius
        
        pt = Rhino.Geometry.Point3d(
            cubeCenterPt.X - xShift,
            cubeCenterPt.Y,
            cubeCenterPt.Z
        )
    
        SpherePosPts.append(pt)
# ---------- end python_9 ----------
python_10 = GhPythonScript(
    RowNum=data,
    ColNum=data,
    CubeCenterPts=python_8.Points,
    CubeRotAngle=python_7.RotAngle,
    CubeRadius=python_6.Radius,
    Theta=rad_2)  # -> out, SpherePosPts, SphereRotAxis, SphereRotAngle; inputs RowNum: Int32, ColNum: Int32, CubeCenterPts: list of Point3d, CubeRotAngle: list
# ---------- python_10: Python ----------
__author__ = "Petingo"
__version__ = "2023.10.30"

import math
import Rhino
import rhinoscriptsyntax as rs

SpherePosPts = []
SphereRotAxis = []
SphereRotAngle = []
for i in range(0, RowNum, 2):
    for k in range(1, ColNum, 2):
        ptIdx = i * RowNum + k
        cubeCenterPt = CubeCenterPts[ptIdx]
        
        xShift = -math.cos(2 * Theta) * CubeRadius
        
        pt = Rhino.Geometry.Point3d(
            cubeCenterPt.X - xShift,
            cubeCenterPt.Y,
            cubeCenterPt.Z
        )
    
        SpherePosPts.append(pt)
# ---------- end python_10 ----------
addition_5 = Addition(A=python_6.Radius, B=data_2)
ln_2 = Line(StartPoint=addition_4, EndPoint=python_8.Points)
addition_6 = Addition(A=python_6.Radius, B=data_2)
box_2 = CenterBox(Base=python_8.Points, X=python_6.Radius, Y=python_6.Radius, Z=python_6.Radius)
Z_5 = UnitZ(Factor=addition_5)
Z_6 = UnitZ(Factor=addition_6)
rotax_2 = RotateAxis(Geometry=box_2, Angle=python_7.RotAngle, Axis=ln_2)  # -> Geometry, Transform
move_3 = Move(Geometry=python_10.SpherePosPts, Motion=Z_6)  # -> Geometry, Transform
move_4 = Move(Geometry=python_9.SpherePosPts, Motion=Z_5)  # -> Geometry, Transform
sph_3 = Sphere(Base=move_3.Geometry, Radius=data_2)
sph_4 = Sphere(Base=move_4.Geometry, Radius=data_2)
preview_4 = CustomPreview(Geometry=rotax_2.Geometry, Material=ColourSwatch(SwatchColor=RGB(255, 255, 255)))  # disabled
preview_5 = CustomPreview(Geometry=sph_3, Material=ColourSwatch(SwatchColor=RGB(112, 177, 212)))  # disabled
preview_6 = CustomPreview(Geometry=sph_4, Material=ColourSwatch(SwatchColor=RGB(212, 112, 139)))  # disabled
